# Dynamo graph RechargerDepuis_script.dyn (Dynamo 2.18.1.5096)
# packages: Genius Loci 2023.7.13, Data-Shapes 2023.2.111, archi-lab.net 2024.217.1024

# group: Input
getDocuments = archilab.Revit.Selection.Select.GetDocuments()
file_path = Filename("..\..\..\..\..\BPA.png")
fromPath = FileObject(path=file_path)  # "File.FromPath"
readFromFile = Image.ReadFromFile(file=fromPath)
code_block = CodeBlock { "Manager Sous-Projet"; "Terminer"; "Recharger Depuis"; }
filepath_data = Custom[FilePath Data](InputName=getDocuments.Link_Name, ButtonText=code_block.out2)  # package Data-Shapes; Create filepath input for UI.MultipleInputForm ++ . Check out www.data-shapes.net for more infos !
inputgroup_data = Custom[InputGroup Data](GroupTitle=code_block.out0, Inputs=filepath_data)  # package Data-Shapes; Creates a group of inputs for UI.MultipleInputForm ++ . Check out www.data-shapes.net for more infos !
boolean = BoolSelector(true)
multipleinputform = Custom[MultipleInputForm ++](Logo_optional=readFromFile, ButtonText_optional=code_block.out1, Inputs=inputgroup_data, Toggle=boolean)  # package Data-Shapes; Create a form with multiple inputs. see www.data-shapes.net for tutorials and infos!

repath_revitlinkinstance = Custom[Repath RevitLinkInstance](RevitLinkInstance=getDocuments.Link_Instance, FilePath=multipleinputform.User_Inputs)  # package Genius Loci; Reloads the Revit link from the input path.
